# Grasshopper definition 1.2.5_the grasshopper definition.gh (Grasshopper 0.9.75)

# ---- group: Number of Divisions
number_slider = Slider(13, range=0..100)

# ---- group: Reference Curve from Rhino
# F.1.4
# The Grasshopper Definition
crv = Curve(reparameterize(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))

# ----
divide = DivideCurve(Curve=crv, Count=number_slider, Kinks=False)  # -> Points, Tangents, Parameters
# Adjust the grips (white
# circles) of the graph
# mapper to change the
# profile of the surface
graph = GraphMapper(
    divide.Parameters,
    x0=0,
    x1=1,
    y0=0,
    y1=1,
    container_name="Sine Summation",
    Equation0_px=[0.4704720378, 0.1303686649],
    Equation0_py=[0, 0.3931849599],
    Equation1_px=[0.2204007357, 1],
    Equation1_py=[0.4534606338, 0.196405828])
multiplication = Multiplication(A=graph, B=Slider(27, range=0..100))
# Draw a circle at each
# division point along the
# curve, normal to the
# tangent vector at each
# point.
circle = CircleCNR(Center=divide.Points, Normal=divide.Tangents, Radius=multiplication)
# Loft a surface between
# the circles
loft = Loft(Curves=circle, Options={Adjust=True, Closed=False, LoftEnds=0, LoftSimp=0, LoftType=2, Rebuild=10, Refit=0.01})
