# Grasshopper definition 1.3.4_domains and color.gh (Grasshopper 0.9.75)

# Adjust radius and
# number of segments
number_slider = Slider(12, range=0..100)

# ---- group: Center Point
# F.2.3
# Domains & Color
# Right-Click and
# select set one point
# to create or select a
# point in model space
pt = Point(Point(-1, 1, 0))

# ----
polygon = Polygon(Plane=pt, Radius=Slider(5, range=0..10), Segments=number_slider, FilletRadius=0)  # -> Polygon, Length
explode = Explode(Curve=polygon.Polygon, Recursive=True)  # -> Segments, Vertices
div = DivideDomain(Domain="0.0 to 1.0", Count=number_slider)
extr = ExtrudePoint(Base=explode.Segments, Point=pt)
dedomain = DeconstructDomain(Domain=div)  # -> Start, End
hsl = ColourHSL(Alpha=1, Hue=dedomain.Start, Saturation=1, Luminance=0.5)
debrep = DeconstructBrep(Brep=extr)  # -> Faces, Edges, Vertices
preview = CustomPreview(Geometry=flatten(debrep.Faces), Shader=hsl)
