# Grasshopper definition 1.3.5_booleans and logical operators.gh (Grasshopper 0.9.75)

# ---- group: Gate And
and = GateAnd(A=Toggle(False), B=Toggle(True))
panel = Panel(and)

# ---- group: Gate Or
or = GateOr(A=Toggle(False), B=Toggle(True))
panel_2 = Panel(or)

# ---- group: Gate Not
not = GateNot(A=Toggle(True))
panel_3 = Panel(not)

# ---- group: Includes
# Double click to change
# the toggle value
panel_4 = Panel("0 to 10")
# F.2.4
# Booleans and Logical Operators
panel_5 = Panel("6.8")
inc = Includes(Value=panel_5, Domain=panel_4)  # -> Includes, Deviation
panel_6 = Panel(inc.Includes)
