# Grasshopper definition 1.4.5_list visualization.gh (Grasshopper 0.9.75)

# ---- group: Point List
domain_high = Panel("20")
steps = Panel("10")
range = Range(Domain=domain_high, Steps=steps)
pt = ConstructPoint(XCoordinate=0, YCoordinate=range, ZCoordinate=0)
points = PointList(Points=pt, Size=1)

# ---- group: Text Tag 3D
domain_high_2 = Panel("20")
steps_2 = Panel("10")
range_2 = Range(Domain=domain_high_2, Steps=steps_2)
list = Panel(range_2)
pt_2 = ConstructPoint(XCoordinate=0, YCoordinate=list, ZCoordinate=0)
tag = TextTag3D(Location=pt_2, Text=list, Size=1, Justification=7)

# ---- group: Construct Points
# F.3.4
# List Visualization
domain_high_3 = Panel("20")
steps_3 = Panel("10")
range_3 = Range(Domain=domain_high_3, Steps=steps_3)
pt_3 = ConstructPoint(XCoordinate=0, YCoordinate=range_3, ZCoordinate=0)
points_2 = Panel(pt_3)

# ---- group: Text Tag
domain_high_4 = Panel("20")
steps_4 = Panel("10")
range_4 = Range(Domain=domain_high_4, Steps=steps_4)
list_2 = Panel(range_4)
pt_4 = ConstructPoint(XCoordinate=0, YCoordinate=list_2, ZCoordinate=0)
tag_2 = TextTag(Location=pt_4, Text=list_2)

# ---- group: Color Gradient
domain_end = Panel("20")
domain_start = Panel("0")
steps_5 = Panel("10")
dom = ConstructDomain(DomainStart=domain_start, DomainEnd=domain_end)
range_5 = Range(Domain=dom, Steps=steps_5)
pt_5 = ConstructPoint(XCoordinate=0, YCoordinate=range_5, ZCoordinate=0)
gradient = Gradient(
    LowerLimit=domain_start,
    UpperLimit=domain_end,
    Parameter=pt_5,
    stops=[0: RGB(234, 38, 0), 0.25: RGB(234, 126, 0), 0.5: RGB(254, 244, 84), 0.75: RGB(173, 203, 249), 1: RGB(75, 107, 169)])
preview = CustomPreview(Geometry=pt_5, Shader=gradient)
