# Grasshopper definition 1.5.3.6_weaving definition.gh (Grasshopper 0.9.75)

# F.4.3.5
# Weaving Definition
divisions = Slider(20, range=0..20)
length = Slider(96, range=0..96)
offset = Slider(4, range=1..10)
of_offsets = Slider(20, range=2..20)
pt = ConstructPoint(XCoordinate=0, YCoordinate=0, ZCoordinate=0)
Y = UnitY(Factor=1)
line = LineSDL(Start=pt, Direction=Y, Length=length)
X = UnitX(Factor=offset)
panel = Panel("""true
false""")

# ---- group: Array Lines
arrlinear = LinearArray(Geometry=line, Direction=X, Count=of_offsets)  # -> Geometry, Transform

# ----
dispatch = Dispatch(List=arrlinear.Geometry, DispatchPattern=panel)  # -> ListA, ListB
divide = DivideCurve(Curve=dispatch.ListA, Count=divisions, Kinks=False)  # -> Points, Tangents, Parameters
divide_2 = DivideCurve(Curve=dispatch.ListB, Count=divisions, Kinks=False)  # -> Points, Tangents, Parameters
panel_2 = Panel("""1
1
0
0""")

# ---- group: Cull Points
cull = CullPattern(List=divide_2.Points, CullPattern=invert(panel_2))
cull_2 = CullPattern(List=divide.Points, CullPattern=panel_2)

# ----
weave = Weave(Pattern=reverse(panel_2), Stream0=cull_2, Stream1=cull, NullGaps=False)
nurbs = NurbsCurve(Vertices=weave, Degree=3, Periodic=False)  # -> Curve, Length, Domain

# ---- group: Revolve
revsrf = Revolution(Curve=nurbs.Curve, Axis=graft(dispatch.ListA), Domain=Domain(0, 6.283185307))
revsrf_2 = Revolution(Curve=nurbs.Curve, Axis=graft(dispatch.ListB), Domain=Domain(0, 6.283185307))
