# Grasshopper definition 1.6.1_what is a mesh.gh (Grasshopper 0.9.76)

merge = Merge(
    Data1=ColourSwatch(SwatchColor=RGB(255, 0, 0)),
    Data2=ColourSwatch(SwatchColor=RGB(0, 255, 0)),
    Data3=ColourSwatch(SwatchColor=RGB(0, 0, 255)))

# ----
# Replace Quad Mesh and Triangle Mesh with a Panel
panel = Panel("4")
panel_2 = Panel("""Q{0,1,2,3}
T{1,2,4}""")
panel_3 = Panel("""Q{0,1,2,3}
T{1,2,4}""")
panel_4 = Panel("""{0,0,0}
{1,0,0}
{1,1,0}
{0,1,0}
{2,0,0}""")
# Color mesh
panel_5 = Panel("""{0,0,0}
{1,0,0}
{1,1,0}
{0,1,0}
{2,0,0}""")
panel_6 = Panel("""{0,0,0}
{1,0,0}
{1,1,0}
{0,1,0}
{2,0,0}""")

# ----
# 1.6.1
# What is a Mesh? Exercise
# Construct mesh with a quad face
quad = MeshQuad(CornerA=0, CornerB=1, CornerC=2, CornerD=3)
conmesh = ConstructMesh(Vertices=[Point(0, 0, 0), Point(10, 0, 0), Point(10, 10, 0), Point(0, 10, 0)], Faces=quad)

quad_2 = MeshQuad(CornerA="0", CornerB="1", CornerC="2", CornerD="3")
triangle = MeshTriangle(CornerA="1", CornerB="2", CornerC=panel)
merge_2 = Merge(Data1=quad_2, Data2=triangle)
conmesh_2 = ConstructMesh(Vertices=panel_6, Faces=merge_2)
conmesh_3 = ConstructMesh(Vertices=panel_4, Faces=panel_2)
conmesh_4 = ConstructMesh(Vertices=panel_5, Faces=panel_3, Colours=merge)

# ----
# Construct a quad face and triangle face
panel_7 = Panel("0")
# Create a list of vertices
panel_8 = Panel("4")
triangle_2 = MeshTriangle(CornerA="1", CornerB="2", CornerC=panel_8)

quad_3 = MeshQuad(CornerA=panel_7, CornerB="1", CornerC="2", CornerD="3")

merge_3 = Merge(Data1=quad_3, Data2=triangle_2)

conmesh_5 = ConstructMesh(Vertices=[Point(0, 0, 0), Point(10, 0, 0), Point(10, 10, 0), Point(0, 10, 0)], Faces=merge_3)
