# Grasshopper definition 1.3.3.5_expressions.gh (Grasshopper 0.9.75)

# You can create different
# Voronoi patterns by
# manipulating the Factor,
# Count, and Radius sliders
number_slider = Slider(20, range=1..30)

# ---- group: Start Point
# F.2.2.4
# Expressions
pt = Point(Point(0, 0, 0))

# ----
X = UnitX(Factor=Slider(1, range=0..1))
arrlinear = LinearArray(Geometry=pt, Direction=X, Count=Slider(100, range=10..200))  # -> Geometry, Transform
pdecon = Deconstruct(Point=arrlinear.Geometry)  # -> XComponent, YComponent, ZComponent
expression = Expression(x=pdecon.XComponent, Expression="x*sin(x)")
expression_2 = Expression(x=pdecon.XComponent, Expression="x*cos(x)")
pt_2 = ConstructPoint(XCoordinate=expression, YCoordinate=expression_2, ZCoordinate=0)
voronoi = Voronoi(Points=pt_2, Radius=number_slider, BruteForceOverride=False)
