# Grasshopper definition 1.4.1.2_grasshopper spline components.gh (Grasshopper 0.9.75)

# ---- group: Polyline
closed = BooleanToggle(False)
pt = Point([Point(2, 26, 0), Point(17, 38, 0), Point(41, 11, 0), Point(49, 28, 0), Point(64, 36, 0), Point(76, 14, 0), Point(93, 26, 0)])
pline = PolyLine(Vertices=pt, Closed=closed)

# ---- group: Nurbs Curve
periodic = BooleanToggle(False)
degree = Panel("3")
# F.3.0.1
# Grasshopper Spline Components
pt_2 = Point([Point(2, 26, 0), Point(17, 38, 0), Point(41, 11, 0), Point(49, 28, 0), Point(64, 36, 0), Point(76, 14, 0), Point(93, 26, 0)])
nurbs = NurbsCurve(Vertices=pt_2, Degree=degree, Periodic=periodic)  # -> Curve, Length, Domain

# ---- group: Interpolate
periodic_2 = BooleanToggle(False)
degree_2 = Panel("3")
pt_3 = Point([Point(2, 26, 0), Point(17, 38, 0), Point(41, 11, 0), Point(49, 28, 0), Point(64, 36, 0), Point(76, 14, 0), Point(93, 26, 0)])
intcrv = Interpolate(Vertices=pt_3, Degree=degree_2, Periodic=periodic_2, KnotStyle=1)  # -> Curve, Length, Domain

# ---- group: Kinky Curve
degree_3 = Panel("3")
angle = Panel("2")
pt_4 = Point([Point(2, 26, 0), Point(17, 38, 0), Point(41, -1.49982169, 0), Point(49, 28, 0), Point(64, 36, 0), Point(76, 14, 0), Point(93, 26, 0)])
kinkcrv = KinkyCurve(Vertices=pt_4, Degree=degree_3, Angle=angle)  # -> Curve, Length, Domain
