# Grasshopper definition 1.4.4_list creation.gh (Grasshopper 0.9.75)

# ---- group: Random
domain_high = Panel("20")
number = Panel("10")
seed = Panel("1")
random = Random(Range=domain_high, Number=number, Seed=seed)
list = Panel(random)

# ---- group: Construct Domain
domain_start = Panel("10")
domain_end = Panel("20")
steps = Panel("10")
dom = ConstructDomain(DomainStart=domain_start, DomainEnd=domain_end)
domain = Panel(dom)
range = Range(Domain=dom, Steps=steps)
list_2 = Panel(range)

# ---- group: Range
# F.3.3
# Creating Lists
domain_high_2 = Panel("20")
steps_2 = Panel("10")
range_2 = Range(Domain=domain_high_2, Steps=steps_2)
list_3 = Panel(range_2)

# ---- group: Series
start = Panel("0")
step = Panel("10")
count = Panel("10")
series = Series(Start=start, Step=step, Count=count)
list_4 = Panel(series)
