# Grasshopper definition 1.4.6_list management.gh (Grasshopper 0.9.75)

# ---- group: Shift List
wrap = BooleanToggle(False)
list = Panel("""0.0
10.0
20.0
30.0
40.0
50.0""")
offset = Panel("1")
shift = ShiftList(List=list, Shift=offset, Wrap=wrap)
list_2 = Panel(shift)

# ---- group: Shift List_Wrap
wrap_2 = BooleanToggle(True)
list_3 = Panel("""0.0
10.0
20.0
30.0
40.0
50.0""")
offset_2 = Panel("1")
shift_2 = ShiftList(List=list_3, Shift=offset_2, Wrap=wrap_2)
list_4 = Panel(shift_2)

# ---- group: List Item
# F.3.5
# List Management
list_5 = Panel("""0.0
10.0
20.0
30.0
40.0
50.0""")
index = Panel("5")
item = ListItem(List=list_5, Index=index, Wrap=True)
item_2 = Panel(item)

# ---- group: Weave
pattern = Panel("""0
1""")
list_6 = Panel("""1
2
3""")
list_7 = Panel("""A
B
C""")
weave = Weave(Pattern=pattern, Stream0=list_6, Stream1=list_7, NullGaps=False)
list_8 = Panel(weave)

# ---- group: Insert Items
list_9 = Panel("""0.0
10.0
20.0
30.0
40.0
50.0""")
items = Panel("""A
B
C""")
index_2 = Panel("3")
ins = InsertItems(List=list_9, Item=items, Indices=index_2, Wrap=True)
list_10 = Panel(ins)

# ---- group: Cull Pattern
list_11 = Panel("""A
B
C
D
E
F""")
pattern_2 = Panel("""0
1""")
cull = CullPattern(List=list_11, CullPattern=pattern_2)
list_12 = Panel(cull)

# ---- group: Reverse List
list_13 = Panel("""0.0
10.0
20.0
30.0
40.0
50.0""")
rev = ReverseList(List=list_13)
list_14 = Panel(rev)

# ---- group: List Length
list_15 = Panel("""0.0
10.0
20.0
30.0
40.0
50.0""")
lng = ListLength(List=list_15)
length = Panel(lng)
