# Grasshopper definition 1.4.7_working with lists.gh (Grasshopper 0.9.75)

# ---- group: Tile 0
# F.3.6
# Working with Lists
geo = Geometry(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)

# ---- group: Tile 1
geo_2 = Geometry(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)

# ---- group: Boundary 0
crv = Curve(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)

# ---- group: Boundary 1
crv_2 = Curve(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)

# ----
recgrid = Rectangular(
    Plane=PlaneXY(0, 0, 0),
    SizeX=Slider(10, range=0..10),
    SizeY=Slider(10, range=0..10),
    ExtentX=Slider(10, range=0..10),
    ExtentY=Slider(10, range=0..10))  # -> flatten(Cells), Points
merge = Merge(Data1=geo, Data2=geo_2)
merge_2 = Merge(Data1=crv, Data2=crv_2)
lng = ListLength(List=recgrid.Cells)
panel = Panel("""1

0
0""")
repeat = RepeatData(Data=panel, Length=lng)
item = ListItem(List=merge_2, Index=repeat, Wrap=True)
item_2 = ListItem(List=merge, Index=repeat, Wrap=True)
recmap = RectangleMapping(Geometry=item_2, Source=item, Target=recgrid.Cells)  # -> Geometry, Transform
