# Grasshopper definition 1.5.1.3_morphing definition.gh (Grasshopper 0.9.75)

# ---- group: Geometry to array
# F.4.0.2
# Morphing Definition
geo = Geometry(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)

# ---- group: Surface to populate
srf = Surface(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)

# ----
divide = DivideDomain²(Domain=srf, UCount=Slider(5, range=0..10), VCount=Slider(5, range=0..10))
sbox = SurfaceBox(Surface=srf, Domain=divide, Height=Slider(2, range=0..10))
bbox = BoundingBox(Content=geo, Plane=PlaneXY(0, 0, 0))  # -> Box, Box_2
morph = BoxMorph(Geometry=geo, Reference=bbox.Box, Target=sbox)
