# Grasshopper definition 1.5.2.1_Data Tree Visualization.gh (Grasshopper 0.9.75)

# ---- group: Tree Statistics
divide = DivideCurve(Curve=[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], Count=10, Kinks=False)  # -> Points, Tangents, Parameters
tstat = TreeStatistics(Tree=divide.Points)  # -> Paths, Length, Count
paths = Panel(tstat.Paths)
count = Panel(tstat.Count)
length = Panel(tstat.Length)

# ---- group: Param Viewer
# F.4.1.0
# Data Tree Visualization
divide_2 = DivideCurve(Curve=[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], Count=10, Kinks=False)  # -> Points, Tangents, Parameters
# Right Click the param viewer and select
# Draw tree to show the tree diagram
viewer = ParamViewer(divide_2.Points)

# ---- group: Param Viewer_Draw tree
divide_3 = DivideCurve(Curve=[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], Count=10, Kinks=False)  # -> Points, Tangents, Parameters
viewer_2 = ParamViewer(divide_3.Points)

# ---- group: Panel
divide_4 = DivideCurve(Curve=[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], Count=10, Kinks=False)  # -> Points, Tangents, Parameters
panel = Panel(divide_4.Points)
