# Grasshopper definition 1.5.3_working with data trees.gh (Grasshopper 0.9.75)

# ---- group: Path Mapper
divide = DivideCurve(Curve=[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], Count=10, Kinks=False)  # -> Points, Tangents, Parameters
divide_2 = DivideCurve(Curve=[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], Count=10, Kinks=False)  # -> Points, Tangents, Parameters
path_mapper = PathMapper(divide.Points, source="{A;B;C}(i)", target="{A;B;i}(C)")
path_mapper_2 = PathMapper(divide_2.Points, source="{A;B;C}", target="{A;B;C}")
viewer = ParamViewer(path_mapper)
viewer_2 = ParamViewer(path_mapper_2)

# ---- group: Flip Matrix
# F.4.3
# Working with Data Trees
divide_3 = DivideCurve(Curve=[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], Count=10, Kinks=False)  # -> Points, Tangents, Parameters
flip = FlipMatrix(Data=divide_3.Points)
viewer_3 = ParamViewer(flip)

# ---- group: Flatten Tree
divide_4 = DivideCurve(Curve=[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], Count=10, Kinks=False)  # -> Points, Tangents, Parameters
flatten = FlattenTree(Tree=divide_4.Points, Path="{0}")
viewer_4 = ParamViewer(flatten)

# ---- group: Graft tree
divide_5 = DivideCurve(Curve=[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], Count=10, Kinks=False)  # -> Points, Tangents, Parameters
graft = GraftTree(Tree=divide_5.Points, IncludeEmptyLists=True, IncludeNullItems=True)
viewer_5 = ParamViewer(graft)

# ---- group: Simplify Tree
divide_6 = DivideCurve(Curve=[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], Count=10, Kinks=False)  # -> Points, Tangents, Parameters
simplify = SimplifyTree(Tree=divide_6.Points, Front=False)
viewer_6 = ParamViewer(simplify)
