# Grasshopper definition 1.5.4_rail intersect definition.gh (Grasshopper 0.9.75)

# ---- group: Rail 1
# F.4.3.6
# Rail Intersect Definition
crv = Curve(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)

# ---- group: Rail 2
crv_2 = Curve(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)

# ---- group: Section
crv_3 = Curve(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)

# ---- group: Surface Divisions
number_slider = Slider(37, range=1..40)
number_slider_2 = Slider(25, range=1..40)

# ----
swp2 = Sweep2(Rail1=crv, Rail2=crv_2, Sections=crv_3, SameHeight=False)

# ---- group: Reparameterized Surface
srf = Surface(reparameterize(swp2))

# ----
divide = DivideDomain²(Domain=srf, UCount=number_slider, VCount=number_slider_2)

# ---- group: Deconstruct Domain
dedom2num = DeconstructDomain²(Domain=divide)  # -> UMin, UMax, VMin, VMax

# ----
merge = Merge(Data1=dedom2num.UMin, Data2=dedom2num.UMax)
lng = ListLength(List=dedom2num.UMax)
graph = GraphMapper(
    merge,
    x0=0,
    x1=1,
    y0=0,
    y1=1,
    container_name="Bezier",
    cpx=[0, 0.9355794787, 0, 1],
    cpy=[0, 0.06608605385, 0.8730433583, 1])
split = SplitList(List=graph, Index=lng)  # -> ListA, ListB

# ---- group: Reconstruct Domain
dom²num = ConstructDomain²(UMin=split.ListA, UMax=split.ListB, VMin=dedom2num.VMin, VMax=dedom2num.VMax)

# ----
subsrf = Isotrim(Surface=srf, Domain=dom²num)
debrep = DeconstructBrep(Brep=subsrf)  # -> Faces, Edges, Vertices
flip = FlipMatrix(Data=debrep.Vertices)
bang = ExplodeTree(Data=simplify(flip))  # -> Branch0, Branch1, Branch2, Branch3
ln = Line(StartPoint=bang.Branch1, EndPoint=bang.Branch3)
ln_2 = Line(StartPoint=bang.Branch0, EndPoint=bang.Branch2)
join = JoinCurves(Curves=[ln, ln_2], Preserve=False)
cp = ControlPoints(Curve=join)  # -> Points, Weights, Knots

# ---- group: Extrusion Distance
number_slider_3 = Slider(5, range=1..5)

# ----
prune = PruneTree(Tree=cp.Points, Minimum="4", Maximum=0)
intcrv = Interpolate(Vertices=prune, Degree=3, Periodic=False, KnotStyle=1)  # -> Curve, Length, Domain
Y = UnitY(Factor=number_slider_3)
extr = Extrude(Base=intcrv.Curve, Direction=Y)
