# Grasshopper definition 1.6.3_creating meshes.gh (Grasshopper 0.9.76)

# ----
# 1.6.3
# Creating Meshes Exercise
# Start with mesh primitive
# Deconstruct mesh, move vertices, and reconstruct mesh
number_slider = Slider(12, range=0..100)
msphere = MeshSphere(Base=PlaneXY(0, 0, 0), Radius=10, UCount=number_slider, VCount=number_slider)

number_slider_2 = Slider(100, range=0..100)
# Color mesh vertices according to transformation magnitude
number_slider_3 = Slider(100, range=0..100)
# Color mesh vertices according to 'light source' vector
number_slider_4 = Slider(100, range=0..100)
# Move vertices using a sine function
number_slider_5 = Slider(100, range=0..100)
msphere_2 = MeshSphere(Base=PlaneXY(0, 0, 0), Radius=10, UCount=number_slider_3, VCount=number_slider_3)
msphere_3 = MeshSphere(Base=PlaneXY(0, 0, 0), Radius=10, UCount=number_slider_4, VCount=number_slider_4)
msphere_4 = MeshSphere(Base=PlaneXY(0, 0, 0), Radius=10, UCount=number_slider_2, VCount=number_slider_2)
msphere_5 = MeshSphere(Base=PlaneXY(0, 0, 0), Radius=10, UCount=number_slider_5, VCount=number_slider_5)
demesh = DeconstructMesh(Mesh=msphere_2)  # -> Vertices, Faces, Colours, Normals
demesh_2 = DeconstructMesh(Mesh=msphere_3)  # -> Vertices, Faces, Colours, Normals

demesh_3 = DeconstructMesh(Mesh=msphere_4)  # -> Vertices, Faces, Colours, Normals
move = Move(Geometry=demesh_3.Vertices, Motion=demesh_3.Normals)  # -> Geometry, Transform
conmesh = ConstructMesh(Vertices=move.Geometry, Faces=demesh_3.Faces)

demesh_4 = DeconstructMesh(Mesh=msphere_5)  # -> Vertices, Faces, Colours, Normals
amplitude = Slider(1.1, range=0..10)
frequency = Slider(5, range=0..5)
amplitude_2 = Slider(1.1, range=0..10)
frequency_2 = Slider(5, range=0..5)

amplitude_3 = Slider(1.1, range=0..10)
frequency_3 = Slider(5, range=0..5)
pdecon = Deconstruct(Point=demesh_4.Vertices)  # -> XComponent, YComponent, ZComponent
expression = Expression(x=pdecon.XComponent, A=amplitude_3, f=frequency_3, Expression="A*sin(x*f/π)")
multiplication = Multiplication(A=demesh_4.Normals, B=expression)

pdecon_2 = Deconstruct(Point=demesh.Vertices)  # -> XComponent, YComponent, ZComponent
pdecon_3 = Deconstruct(Point=demesh_2.Vertices)  # -> XComponent, YComponent, ZComponent
expression_2 = Expression(x=pdecon_2.XComponent, A=amplitude, f=frequency, Expression="A*sin(x*f/π)")
expression_3 = Expression(x=pdecon_3.XComponent, A=amplitude_2, f=frequency_2, Expression="A*sin(x*f/π)")
multiplication_2 = Multiplication(A=demesh.Normals, B=expression_2)
multiplication_3 = Multiplication(A=demesh_2.Normals, B=expression_3)
move_2 = Move(Geometry=demesh.Vertices, Motion=multiplication_2)  # -> Geometry, Transform
move_3 = Move(Geometry=demesh_2.Vertices, Motion=multiplication_3)  # -> Geometry, Transform
move_4 = Move(Geometry=demesh_4.Vertices, Motion=multiplication)  # -> Geometry, Transform
conmesh_2 = ConstructMesh(Vertices=move_2.Geometry, Faces=demesh.Faces)
conmesh_3 = ConstructMesh(Vertices=move_3.Geometry, Faces=demesh_2.Faces)
conmesh_4 = ConstructMesh(Vertices=move_4.Geometry, Faces=demesh_4.Faces)

gradient = Gradient(
    LowerLimit=0,
    UpperLimit=amplitude,
    Parameter=expression_2,
    stops=[0: RGB(234, 38, 0), 0.201: RGB(234, 126, 0), 0.5: RGB(254, 244, 84), 0.803: RGB(173, 203, 249), 1: RGB(75, 107, 169)])
mcol = MeshColours(Mesh=conmesh_2, Colours=gradient)

demesh_5 = DeconstructMesh(Mesh=conmesh_3)  # -> Vertices, Faces, Colours, Normals
Z = UnitZ(Factor=1)
angle = Angle(VectorA=demesh_5.Normals, VectorB=Z)  # -> Angle, Reflex
pi = Pi(Factor=1)
gradient_2 = Gradient(LowerLimit=0, UpperLimit=pi, Parameter=angle.Angle, stops=[0: RGB(255, 255, 255), 1: RGB(0, 0, 0)])

mcol_2 = MeshColours(Mesh=conmesh_3, Colours=gradient_2)
