# Grasshopper definition 1.6.4_what is a mesh.gh (Grasshopper 0.9.76)

panel = Panel("""Q{0,1,2,3}
T{1,2,4}""")
panel_2 = Panel("""Q{0,1,2,3}
T{1,2,4}""")
panel_3 = Panel("""{0,0,0}
{1,0,0}
{1,1,0}
{0,1,0}
{2,0,0}""")
panel_4 = Panel("""{0,0,0}
{1,0,0}
{1,1,0}
{0,1,0}
{2,0,0}""")
panel_5 = Panel("""{0,0,0}
{1,0,0}
{1,1,0}
{0,1,0}
{2,0,0}""")
merge = Merge(
    Data1=ColourSwatch(SwatchColor=RGB(255, 0, 0)),
    Data2=ColourSwatch(SwatchColor=RGB(0, 255, 0)),
    Data3=ColourSwatch(SwatchColor=RGB(0, 0, 255)))
quad = MeshQuad(CornerA=0, CornerB=1, CornerC=2, CornerD=3)
quad_2 = MeshQuad(CornerA="0", CornerB="1", CornerC="2", CornerD="3")
quad_3 = MeshQuad(CornerA="0", CornerB="1", CornerC="2", CornerD="3")
triangle = MeshTriangle(CornerA="1", CornerB="2", CornerC="4")
triangle_2 = MeshTriangle(CornerA="1", CornerB="2", CornerC="4")
merge_2 = Merge(Data1=quad_3, Data2=triangle_2)
merge_3 = Merge(Data1=quad_2, Data2=triangle)
conmesh = ConstructMesh(Vertices=[Point(0, 0, 0), Point(10, 0, 0), Point(10, 10, 0), Point(0, 10, 0)], Faces=quad)
conmesh_2 = ConstructMesh(Vertices=[Point(0, 0, 0), Point(10, 0, 0), Point(10, 10, 0), Point(0, 10, 0)], Faces=merge_3)
conmesh_3 = ConstructMesh(Vertices=panel_5, Faces=merge_2)
conmesh_4 = ConstructMesh(Vertices=panel_3, Faces=panel)
conmesh_5 = ConstructMesh(Vertices=panel_4, Faces=panel_2, Colours=merge)
