# Grasshopper definition 1.6.5_element addon.gh (Grasshopper 0.9.76)
# plug-ins: Element

# ----
# 1.6.4
# Element Add-On Exercise
# Start with mesh primitive
number_slider = Slider(25, range=5..50)
th = ElementIcosahedron(Radius=number_slider)  # -> Polylines, TetrahedronMesh
fn = ElementFaceNeighbours(Mesh=th.TetrahedronMesh)  # -> FaceCenters, FaceVertices, NeighbouringBorderingEdges, NeighbouringFaceCenters

# ----
# Create polyline rings for each face and build mesh frames
number_slider_2 = Slider(25, range=5..50)
# Combine, thicken, and subdivide mesh
number_slider_3 = Slider(25, range=5..50)
# Evaluate face edges to truncate face triangles
number_slider_4 = Slider(25, range=5..50)
number_slider_5 = Slider(0.25, range=0..0.5)
number_slider_6 = Slider(0.25, range=0..0.5)
th_2 = ElementIcosahedron(Radius=number_slider_2)  # -> Polylines, TetrahedronMesh
subtraction = Subtraction(A="1", B=number_slider_6)
th_3 = ElementIcosahedron(Radius=number_slider_3)  # -> Polylines, TetrahedronMesh
subtraction_2 = Subtraction(A="1", B=number_slider_5)
th_4 = ElementIcosahedron(Radius=number_slider_4)  # -> Polylines, TetrahedronMesh
fn_2 = ElementFaceNeighbours(Mesh=th_2.TetrahedronMesh)  # -> FaceCenters, FaceVertices, NeighbouringBorderingEdges, NeighbouringFaceCenters
fn_3 = ElementFaceNeighbours(Mesh=th_3.TetrahedronMesh)  # -> FaceCenters, FaceVertices, NeighbouringBorderingEdges, NeighbouringFaceCenters
merge = Merge(Data1=number_slider_6, Data2=subtraction)
merge_2 = Merge(Data1=number_slider_5, Data2=subtraction_2)
fn_4 = ElementFaceNeighbours(Mesh=th_4.TetrahedronMesh)  # -> FaceCenters, FaceVertices, NeighbouringBorderingEdges, NeighbouringFaceCenters

number_slider_7 = Slider(0.25, range=0..0.5)
subtraction_3 = Subtraction(A="1", B=number_slider_7)
merge_3 = Merge(Data1=number_slider_7, Data2=subtraction_3)
eval = EvaluateCurve(Curve=graft(fn_4.NeighbouringBorderingEdges), Parameter=merge_3)  # -> Point, Tangent, Angle

eval_2 = EvaluateCurve(Curve=graft(fn_2.NeighbouringBorderingEdges), Parameter=merge)  # -> Point, Tangent, Angle
eval_3 = EvaluateCurve(Curve=graft(fn_3.NeighbouringBorderingEdges), Parameter=merge_2)  # -> Point, Tangent, Angle
trim = TrimTree(Tree=eval_3.Point, Depth=1)

trim_2 = TrimTree(Tree=eval_2.Point, Depth=1)
pline = PolyLine(Vertices=trim_2, Closed=True)
mf = ElementMeshFrame(Geometry=pline, Factor=Slider(0.25, range=0..1), PerVertexData=0, MinAndMaxValues=Domain(0.1, 1), Type=0)

pline_2 = PolyLine(Vertices=trim, Closed=True)
mf_2 = ElementMeshFrame(Geometry=pline_2, Factor=Slider(0.25, range=0..1), PerVertexData=0, MinAndMaxValues=Domain(0.1, 1), Type=0)

mc = ElementMeshCombineClean(Mesh=flatten(mf_2), Angle=100, UnifyNormals=True, FlipMesh=False)
mt = ElementMeshThicken(Mesh=mc, Distance=1, PerVertexData=0, MinAndMaxValues=Domain(0.1, 1), Type=0)
cc = ElementCatmullClarkSubdivision(Mesh=mt, Iterations=2, EdgeCondition=0)

# ----
# Add attractor point to drive mesh thickness - FINAL DEFINITION
number_slider_8 = Slider(25, range=5..50)
number_slider_9 = Slider(0.25, range=0..0.5)
th_5 = ElementIcosahedron(Radius=number_slider_8)  # -> Polylines, TetrahedronMesh
subtraction_4 = Subtraction(A="1", B=number_slider_9)
fn_5 = ElementFaceNeighbours(Mesh=th_5.TetrahedronMesh)  # -> FaceCenters, FaceVertices, NeighbouringBorderingEdges, NeighbouringFaceCenters
merge_4 = Merge(Data1=number_slider_9, Data2=subtraction_4)
eval_4 = EvaluateCurve(Curve=graft(fn_5.NeighbouringBorderingEdges), Parameter=merge_4)  # -> Point, Tangent, Angle
trim_3 = TrimTree(Tree=eval_4.Point, Depth=1)
pline_3 = PolyLine(Vertices=trim_3, Closed=True)
mf_3 = ElementMeshFrame(Geometry=pline_3, Factor=Slider(0.25, range=0..1), PerVertexData=0, MinAndMaxValues=Domain(0.1, 1), Type=0)
mc_2 = ElementMeshCombineClean(Mesh=flatten(mf_3), Angle=100, UnifyNormals=True, FlipMesh=False)

demesh = DeconstructMesh(Mesh=mc_2)  # -> Vertices, Faces, Colours, Normals
pt = Point(Point(-0.05983771701, 30.24359631, 3.682774009))
dist = Distance(PointA=demesh.Vertices, PointB=pt)
dom = ConstructDomain(DomainStart=Slider(1, range=0..1), DomainEnd=Slider(8, range=0..10))

mt_2 = ElementMeshThicken(Mesh=mc_2, Distance=1, PerVertexData=dist, MinAndMaxValues=dom, Type=1)
cc_2 = ElementCatmullClarkSubdivision(Mesh=mt_2, Iterations=2, EdgeCondition=0)
