# Grasshopper definition 1.6.6_working with meshes.gh (Grasshopper 0.9.76)

v_count = Slider(12, range=0..100)
# 1.6.5
# Textured Vase Exercise
# Create series of circles to define vase
number_slider = Slider(10, range=0..10)
pt = Point(Point(0, 0, 0))
line = LineSDL(Start=pt, Direction=Vector(0, 0, 1), Length=number_slider)
divide = DivideCurve(Curve=line, Count=v_count, Kinks=False)  # -> Points, Tangents, Parameters
circle = CircleCNR(Center=divide.Points, Normal=Vector(0, 0, 1), Radius=1)

# ----
# Fill gap between offset surfaces to complete model
number_slider_2 = Slider(10, range=0..10)
number_slider_3 = Slider(30, range=0..100)
v_count_2 = Slider(12, range=0..100)
# Offset vase surface for creating a solid
number_slider_4 = Slider(10, range=0..10)
# Add corrugation to vase
number_slider_5 = Slider(10, range=0..10)
# Create mesh faces for bottom
number_slider_6 = Slider(10, range=0..10)
number_slider_7 = Slider(30, range=0..100)
# Use graph mapper to define vase profile
number_slider_8 = Slider(10, range=0..10)
# Add twist to vase
number_slider_9 = Slider(10, range=0..10)
# Create mesh faces for vase sides
number_slider_10 = Slider(10, range=0..10)
number_slider_11 = Slider(30, range=0..100)
v_count_3 = Slider(12, range=0..100)
v_count_4 = Slider(30, range=0..100)
v_count_5 = Slider(12, range=0..100)
pt_2 = Point(Point(0, 0, 0))
pt_3 = Point(Point(0, 0, 0))
pt_4 = Point(Point(0, 0, 0))
pt_5 = Point(Point(0, 0, 0))
pt_6 = Point(Point(0, 0, 0))
pt_7 = Point(Point(0, 0, 0))
pt_8 = Point(Point(0, 0, 0))
range = Range(Domain=Domain(0, 1), Steps=number_slider_3)
range_2 = Range(Domain=Domain(0, 1), Steps=number_slider_7)
range_3 = Range(Domain=Domain(0, 1), Steps=number_slider_11)
line_2 = LineSDL(Start=pt_2, Direction=Vector(0, 0, 1), Length=number_slider_2)
range_4 = Range(Domain=Domain(0, 1), Steps=v_count_4)

range_5 = Range(Domain=Domain(0, 1), Steps=v_count_2)
width = Slider(6, range=0..10)
graph = GraphMapper(
    range_5,
    x0=0,
    x1=1,
    y0=0,
    y1=1,
    container_name="Bezier",
    cpx=[0, 0.2481884062, 0.2119565159, 1],
    cpy=[0.1955710053, 1, 0.07427537441, 0.210144937])
multiplication = Multiplication(A=graph, B=width)

range_6 = Range(Domain=Domain(0, 1), Steps=v_count_5)
line_3 = LineSDL(Start=pt_3, Direction=Vector(0, 0, 1), Length=number_slider_4)
range_7 = Range(Domain=Domain(0, 1), Steps=v_count_3)
line_4 = LineSDL(Start=pt_5, Direction=Vector(0, 0, 1), Length=number_slider_5)
line_5 = LineSDL(Start=pt_4, Direction=Vector(0, 0, 1), Length=number_slider_6)
line_6 = LineSDL(Start=pt_8, Direction=Vector(0, 0, 1), Length=number_slider_9)
line_7 = LineSDL(Start=pt_6, Direction=Vector(0, 0, 1), Length=number_slider_8)
line_8 = LineSDL(Start=pt_7, Direction=Vector(0, 0, 1), Length=number_slider_10)
width_2 = Slider(6, range=0..10)
width_3 = Slider(6, range=0..10)
width_4 = Slider(6, range=0..10)
graph_2 = GraphMapper(
    range,
    x0=0,
    x1=1,
    y0=0,
    y1=1,
    container_name="Bezier",
    cpx=[0, 0.3327535093, 0.4533333182, 1],
    cpy=[0.2308384776, 0.6544932127, 0.1257978678, 0.210144937])
graph_3 = GraphMapper(
    range_2,
    x0=0,
    x1=1,
    y0=0,
    y1=1,
    container_name="Bezier",
    cpx=[0, 0.3327535093, 0.4533333182, 1],
    cpy=[0.2985503674, 0.6544932127, 0.1257978678, 0.210144937])
graph_4 = GraphMapper(
    range_3,
    x0=0,
    x1=1,
    y0=0,
    y1=1,
    container_name="Bezier",
    cpx=[0, 0.3327535093, 0.4533333182, 1],
    cpy=[0.2985503674, 0.6544932127, 0.1257978678, 0.210144937])
graph_5 = GraphMapper(
    range_7,
    x0=0,
    x1=1,
    y0=0,
    y1=1,
    container_name="Bezier",
    cpx=[0, 0.2481884062, 0.2119565159, 1],
    cpy=[0.1467391253, 1, 0.07427537441, 0.210144937])
graph_6 = GraphMapper(
    range_4,
    x0=0,
    x1=1,
    y0=0,
    y1=1,
    container_name="Bezier",
    cpx=[0, 0.2481884062, 0.2119565159, 1],
    cpy=[0.1467391253, 1, 0.07427537441, 0.210144937])
graph_7 = GraphMapper(
    range_6,
    x0=0,
    x1=1,
    y0=0,
    y1=1,
    container_name="Bezier",
    cpx=[0, 0.2481884062, 0.2119565159, 1],
    cpy=[0.1467391253, 1, 0.07427537441, 0.210144937])
divide_2 = DivideCurve(Curve=line_2, Count=number_slider_3, Kinks=False)  # -> Points, Tangents, Parameters
divide_3 = DivideCurve(Curve=line_3, Count=number_slider_7, Kinks=False)  # -> Points, Tangents, Parameters
divide_4 = DivideCurve(Curve=line_4, Count=number_slider_11, Kinks=False)  # -> Points, Tangents, Parameters
divide_5 = DivideCurve(Curve=line_5, Count=v_count_3, Kinks=False)  # -> Points, Tangents, Parameters
divide_6 = DivideCurve(Curve=line_6, Count=v_count_4, Kinks=False)  # -> Points, Tangents, Parameters
divide_7 = DivideCurve(Curve=line_7, Count=v_count_2, Kinks=False)  # -> Points, Tangents, Parameters
divide_8 = DivideCurve(Curve=line_8, Count=v_count_5, Kinks=False)  # -> Points, Tangents, Parameters
multiplication_2 = Multiplication(A=graph_5, B=width_3)
multiplication_3 = Multiplication(A=graph_7, B=width_2)
multiplication_4 = Multiplication(A=graph_2, B=Slider(6, range=0..10))
multiplication_5 = Multiplication(A=graph_3, B=Slider(6, range=0..10))
multiplication_6 = Multiplication(A=graph_4, B=Slider(6, range=0..10))
multiplication_7 = Multiplication(A=graph_6, B=width_4)
circle_2 = CircleCNR(Center=divide_2.Points, Normal=Vector(0, 0, 1), Radius=multiplication_4)
circle_3 = CircleCNR(Center=divide_3.Points, Normal=Vector(0, 0, 1), Radius=multiplication_5)
circle_4 = CircleCNR(Center=divide_4.Points, Normal=Vector(0, 0, 1), Radius=multiplication_6)
circle_5 = CircleCNR(Center=divide_5.Points, Normal=Vector(0, 0, 1), Radius=multiplication_2)
circle_6 = CircleCNR(Center=divide_6.Points, Normal=Vector(0, 0, 1), Radius=multiplication_7)

multiplication_8 = Multiplication(A=graph_6, B=Slider(0.3, range=0..1))
seam = Seam(Curve=reparameterize(circle_6), Seam=multiplication_8)

circle_7 = CircleCNR(Center=divide_7.Points, Normal=Vector(0, 0, 1), Radius=multiplication)
circle_8 = CircleCNR(Center=divide_8.Points, Normal=Vector(0, 0, 1), Radius=multiplication_3)
u_count = Slider(10, range=0..100)
multiplication_9 = Multiplication(A=graph_2, B=Slider(0.5, range=0..1))
number_slider_12 = Slider(24, range=0..100)
multiplication_10 = Multiplication(A=graph_3, B=Slider(0.5, range=0..1))
multiplication_11 = Multiplication(A=graph_4, B=Slider(0.5, range=0..1))
number_slider_13 = Slider(24, range=0..100)
number_slider_14 = Slider(24, range=0..100)

u_count_2 = Slider(10, range=0..100)
divide_9 = DivideCurve(Curve=circle_8, Count=u_count_2, Kinks=False)  # -> Points, Tangents, Parameters
series = Series(Start=0, Step=u_count_2, Count=v_count_5)
flatten = FlattenTree(Tree=divide_9.Points, Path="{0}")
series_2 = Series(Start=series, Step=1, Count=u_count_2)
shift = ShiftList(List=series_2, Shift=1, Wrap=True)
addition = Addition(A=shift, B=u_count_2)
addition_2 = Addition(A=series_2, B=u_count_2)
quad = MeshQuad(CornerA=series_2, CornerB=shift, CornerC=addition, CornerD=addition_2)
conmesh = ConstructMesh(Vertices=flatten, Faces=flatten(quad))

seam_2 = Seam(Curve=reparameterize(circle_2), Seam=multiplication_9)
seam_3 = Seam(Curve=reparameterize(circle_3), Seam=multiplication_10)
seam_4 = Seam(Curve=reparameterize(circle_4), Seam=multiplication_11)
u_count_3 = Slider(21, range=0..100)
divide_10 = DivideCurve(Curve=circle_5, Count=u_count, Kinks=False)  # -> Points, Tangents, Parameters
series_3 = Series(Start=0, Step=u_count, Count=v_count_3)
flatten_2 = FlattenTree(Tree=divide_10.Points, Path="{0}")
divide_11 = DivideCurve(Curve=seam_2, Count=number_slider_12, Kinks=False)  # -> Points, Tangents, Parameters
divide_12 = DivideCurve(Curve=seam_3, Count=number_slider_14, Kinks=False)  # -> Points, Tangents, Parameters
divide_13 = DivideCurve(Curve=seam_4, Count=number_slider_13, Kinks=False)  # -> Points, Tangents, Parameters
divide_14 = DivideCurve(Curve=seam, Count=u_count_3, Kinks=False)  # -> Points, Tangents, Parameters
series_4 = Series(Start=series_3, Step=1, Count=u_count)
dispatch = Dispatch(List=divide_11.Points, DispatchPattern=[True, False])  # -> ListA, ListB
dispatch_2 = Dispatch(List=divide_12.Points, DispatchPattern=[True, False])  # -> ListA, ListB

dispatch_3 = Dispatch(List=divide_13.Points, DispatchPattern=[True, False])  # -> ListA, ListB
vec2pt = Vector2Pt(PointA=dispatch_3.ListB, PointB=graft(divide_4.Points), Unitize=True)  # -> Vector, Length
multiplication_12 = Multiplication(A=vec2pt.Vector, B=Slider(0.298, range=0..1))
move = Move(Geometry=dispatch_3.ListB, Motion=multiplication_12)  # -> Geometry, Transform
weave = Weave(Pattern=[0, 1], Stream0=dispatch_3.ListA, Stream1=move.Geometry, NullGaps=False)

shift_2 = ShiftList(List=series_4, Shift=1, Wrap=True)
flatten_3 = FlattenTree(Tree=divide_14.Points, Path="{0}")
series_5 = Series(Start=0, Step=u_count_3, Count=v_count_4)
addition_3 = Addition(A=shift_2, B=u_count)
addition_4 = Addition(A=series_4, B=u_count)
vec2pt_2 = Vector2Pt(PointA=dispatch.ListB, PointB=graft(divide_2.Points), Unitize=True)  # -> Vector, Length
vec2pt_3 = Vector2Pt(PointA=dispatch_2.ListB, PointB=graft(divide_3.Points), Unitize=True)  # -> Vector, Length
series_6 = Series(Start=series_5, Step=1, Count=u_count_3)
series_7 = Series(Start=0, Step=1, Count=u_count_3)
shift_3 = ShiftList(List=series_6, Shift=1, Wrap=True)
shift_4 = ShiftList(List=series_7, Shift=1, Wrap=True)
quad_2 = MeshQuad(CornerA=series_4, CornerB=shift_2, CornerC=addition_3, CornerD=addition_4)

series_8 = Series(Start=0, Step=1, Count=u_count)
shift_5 = ShiftList(List=series_8, Shift=1, Wrap=True)
lng = ListLength(List=flatten_2)
triangle = MeshTriangle(CornerA=series_8, CornerB=lng, CornerC=shift_5)
merge = Merge(Data1=quad_2, Data2=triangle)
merge_2 = Merge(Data1=flatten_2, Data2=pt_4)

multiplication_13 = Multiplication(A=vec2pt_2.Vector, B=Slider(0.298, range=0..1))
multiplication_14 = Multiplication(A=vec2pt_3.Vector, B=Slider(0.298, range=0..1))
addition_5 = Addition(A=shift_3, B=u_count_3)
addition_6 = Addition(A=series_6, B=u_count_3)
lng_2 = ListLength(List=flatten_3)
move_2 = Move(Geometry=dispatch.ListB, Motion=multiplication_13)  # -> Geometry, Transform
move_3 = Move(Geometry=dispatch_2.ListB, Motion=multiplication_14)  # -> Geometry, Transform
quad_3 = MeshQuad(CornerA=series_6, CornerB=shift_3, CornerC=addition_5, CornerD=addition_6)
triangle_2 = MeshTriangle(CornerA=series_7, CornerB=lng_2, CornerC=shift_4)
weave_2 = Weave(Pattern=[0, 1], Stream0=dispatch.ListA, Stream1=move_2.Geometry, NullGaps=False)
conmesh_2 = ConstructMesh(Vertices=merge_2, Faces=flatten(merge))
weave_3 = Weave(Pattern=[0, 1], Stream0=dispatch_2.ListA, Stream1=move_3.Geometry, NullGaps=False)
merge_3 = Merge(Data1=flatten_3, Data2=pt_8)
merge_4 = Merge(Data1=quad_3, Data2=triangle_2)
conmesh_3 = ConstructMesh(Vertices=merge_3, Faces=flatten(merge_4))
flatten_4 = FlattenTree(Tree=weave_2, Path="{0}")
series_9 = Series(Start=0, Step=number_slider_12, Count=number_slider_3)
flatten_5 = FlattenTree(Tree=weave_3, Path="{0}")
series_10 = Series(Start=0, Step=number_slider_14, Count=number_slider_7)
flatten_6 = FlattenTree(Tree=weave, Path="{0}")
series_11 = Series(Start=0, Step=number_slider_13, Count=number_slider_11)
series_12 = Series(Start=series_9, Step=1, Count=number_slider_12)
series_13 = Series(Start=0, Step=1, Count=number_slider_12)
series_14 = Series(Start=series_10, Step=1, Count=number_slider_14)
series_15 = Series(Start=0, Step=1, Count=number_slider_14)
series_16 = Series(Start=series_11, Step=1, Count=number_slider_13)
series_17 = Series(Start=0, Step=1, Count=number_slider_13)
shift_6 = ShiftList(List=series_12, Shift=1, Wrap=True)
shift_7 = ShiftList(List=series_13, Shift=1, Wrap=True)
shift_8 = ShiftList(List=series_17, Shift=1, Wrap=True)
shift_9 = ShiftList(List=series_14, Shift=1, Wrap=True)
shift_10 = ShiftList(List=series_16, Shift=1, Wrap=True)
shift_11 = ShiftList(List=series_15, Shift=1, Wrap=True)
lng_3 = ListLength(List=flatten_4)
addition_7 = Addition(A=shift_6, B=number_slider_12)
addition_8 = Addition(A=series_12, B=number_slider_12)
lng_4 = ListLength(List=flatten_5)
lng_5 = ListLength(List=flatten_6)
addition_9 = Addition(A=shift_9, B=number_slider_14)
addition_10 = Addition(A=series_14, B=number_slider_14)
addition_11 = Addition(A=shift_10, B=number_slider_13)
addition_12 = Addition(A=series_16, B=number_slider_13)
quad_4 = MeshQuad(CornerA=series_12, CornerB=shift_6, CornerC=addition_7, CornerD=addition_8)
triangle_3 = MeshTriangle(CornerA=series_13, CornerB=lng_3, CornerC=shift_7)
quad_5 = MeshQuad(CornerA=series_14, CornerB=shift_9, CornerC=addition_9, CornerD=addition_10)
triangle_4 = MeshTriangle(CornerA=series_15, CornerB=lng_4, CornerC=shift_11)
quad_6 = MeshQuad(CornerA=series_16, CornerB=shift_10, CornerC=addition_11, CornerD=addition_12)
triangle_5 = MeshTriangle(CornerA=series_17, CornerB=lng_5, CornerC=shift_8)
merge_5 = Merge(Data1=quad_4, Data2=triangle_3)
merge_6 = Merge(Data1=flatten_4, Data2=pt_2)
merge_7 = Merge(Data1=quad_5, Data2=triangle_4)
merge_8 = Merge(Data1=quad_6, Data2=triangle_5)
merge_9 = Merge(Data1=flatten_5, Data2=pt_3)
merge_10 = Merge(Data1=flatten_6, Data2=pt_5)
conmesh_4 = ConstructMesh(Vertices=merge_6, Faces=flatten(merge_5))
conmesh_5 = ConstructMesh(Vertices=merge_9, Faces=flatten(merge_7))
conmesh_6 = ConstructMesh(Vertices=merge_10, Faces=flatten(merge_8))

demesh = DeconstructMesh(Mesh=conmesh_5)  # -> Vertices, Faces, Colours, Normals
multiplication_15 = Multiplication(A=demesh.Normals, B=Slider(0.2, range=0..1))
move_4 = Move(Geometry=demesh.Vertices, Motion=multiplication_15)  # -> Geometry, Transform
conmesh_7 = ConstructMesh(Vertices=move_4.Geometry, Faces=demesh.Faces)

demesh_2 = DeconstructMesh(Mesh=conmesh_4)  # -> Vertices, Faces, Colours, Normals
multiplication_16 = Multiplication(A=demesh_2.Normals, B=Slider(0.2, range=0..1))
move_5 = Move(Geometry=demesh_2.Vertices, Motion=multiplication_16)  # -> Geometry, Transform
conmesh_8 = ConstructMesh(Vertices=move_5.Geometry, Faces=demesh_2.Faces)

medges = MeshEdges(Mesh=conmesh_4)  # -> NakedEdges, InteriorEdges, NonManifoldEdges
medges_2 = MeshEdges(Mesh=conmesh_8)  # -> NakedEdges, InteriorEdges, NonManifoldEdges
join = JoinCurves(Curves=medges.NakedEdges, Preserve=False)
join_2 = JoinCurves(Curves=medges_2.NakedEdges, Preserve=False)
cp = ControlPoints(Curve=join)  # -> Points, Weights, Knots
cp_2 = ControlPoints(Curve=join_2)  # -> Points, Weights, Knots
shift_12 = ShiftList(List=cp.Points, Shift=1, Wrap=True)
shift_13 = ShiftList(List=cp_2.Points, Shift=1, Wrap=True)
entwine = Entwine(Branch00=cp.Points, Branch01=shift_12, Branch02=shift_13, Branch03=cp_2.Points, FlattenInputs=True)
flip = FlipMatrix(Data=entwine)
conmesh_9 = ConstructMesh(Vertices=flip, Faces={A=0, B=1, C=2, D=3})
mjoin = MeshJoin(Meshes=flatten([conmesh_4, conmesh_8, conmesh_9]))
