# Grasshopper definition 2.1.5.1_Architecture Case Study_A.gh (Grasshopper 0.9.76)
# plug-ins: Element

# ---- group: Input Mesh
# Element_Primer_Architectural Case Study A Example File
# Uses mesh half edge data and Element* components without per vertex data to create an architectural facade elements.
mesh = Mesh(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)

# ---- group: Mesh Combine & Clean
mc = ElementMeshCombineClean(Mesh=mesh, Angle=100, MergeVertices=True, FlipMesh=False, CombineType=0)

# ---- group: Mesh Data
vn = ElementVertexNeighbours(Mesh=mc)  # -> Vertices, NeighbouringVertices, NeighbouringEdges, NeighbouringFaceCenters

# ----
eval = EvaluateCurve(Curve=reparameterize(vn.NeighbouringEdges), Parameter=Slider(0.6, range=0..1))  # -> Point, Tangent, Angle
pt = Point(vn.NeighbouringFaceCenters)

# ---- group: Mesh Closest Point
cp = ElementMeshClosestPoint(Mesh=mc, Point=eval.Point, Color=0)  # -> Parameter, Point, FaceIndex, Normal, Colour

# ----
amp = Amplitude(Vector=cp.Normal, Amplitude=Slider(2.8576, range=0..10))
move = Move(Geometry=cp.Point, Motion=amp)  # -> Geometry, Transform
weave = Weave(Pattern=[0, 1], Stream0=move.Geometry, Stream1=pt, NullGaps=False)
pline = PolyLine(Vertices=weave, Closed=True)

# ---- group: Mesh Frame
mf = ElementMeshFrame(Mesh=pline, Factor=Slider(0.761, range=0.1..1), PerVertexData=0, MinAndMaxValues=Domain(0.1, 1), Type=0)

# ---- group: Mesh Combine & Clean
mc_2 = ElementMeshCombineClean(Mesh=flatten(mf), Angle=100, MergeVertices=True, FlipMesh=False, CombineType=Slider(1, range=0..1))

# ----
ms = ElementMeshStatus(Mesh=mc_2, MergeVertices=False)  # -> Info, Status
preview = CustomPreview(Geometry=mc_2, Shader=ColourSwatch(SwatchColor=RGB(0, 141, 178)))
panel = Panel(ms.Info)
panel_2 = Panel(ms.Status)
