# Grasshopper definition 2.1.5.2_Architecture Case Study_B.gh (Grasshopper 0.9.76)
# plug-ins: Element

# ---- group: Input Mesh
# Element_Primer_Architectural Case Study B Example File
# Uses mesh half edge data and Element* components without per vertex data to create an architectural facade pattern
mesh = Mesh(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)

# ---- group: Mesh Combine & Clean
mc = ElementMeshCombineClean(Mesh=mesh, Angle=100, MergeVertices=True, FlipMesh=False, CombineType=0)

# ---- group: Mesh Data
vn = ElementVertexNeighbours(Mesh=mc)  # -> Vertices, NeighbouringVertices, NeighbouringEdges, NeighbouringFaceCenters

# ----
vec2pt = Vector2Pt(PointA=vn.Vertices, PointB=vn.NeighbouringVertices, Unitize=False)  # -> Vector, Length
t = Slider(1.5, range=0.1..1.5)
multiplication = Multiplication(A=vec2pt.Vector, B=t)
addition = Addition(A=vn.Vertices, B=multiplication)
pline = PolyLine(Vertices=addition, Closed=True)
pline_2 = PolyLine(Vertices=vn.NeighbouringVertices, Closed=True)
mf = ElementMeshFrame(Mesh=pline_2, Factor=Slider(0.086, range=0.05..0.95), PerVertexData=0, MinAndMaxValues=Domain(0.1, 1), Type=0)

# ---- group: Mesh Frame
mf_2 = ElementMeshFrame(Mesh=pline, Factor=Slider(0.165, range=0.05..0.95), PerVertexData=0, MinAndMaxValues=Domain(0.1, 1), Type=0)

# ---- group: Mesh Subdivide
cc = ElementCatmullClarkSubdivision(Mesh=mf_2, Iterations="1", EdgeCondition="1")
cc_2 = ElementCatmullClarkSubdivision(Mesh=mf, Iterations="1", EdgeCondition="1")

# ----
merge = Merge(Data1=cc, Data2=cc_2)  # -> flatten(Result)

# ---- group: Mesh Combine & Clean
mc_2 = ElementMeshCombineClean(Mesh=merge, Angle=100, MergeVertices=True, FlipMesh=True, CombineType=0)

# ---- group: Mesh Edges
me = ElementMeshEdges(Mesh=mc_2)  # -> NakedEdges, MeshEdges, FacePolylines, UnweldedEdges

# ---- group: Mesh Frame
mf_3 = ElementMeshFrame(Mesh=me.FacePolylines, Factor=Slider(0.129, range=0..1), PerVertexData=0, MinAndMaxValues=Domain(0.1, 1), Type=0)

# ---- group: Mesh Combine & Clean
mc_3 = ElementMeshCombineClean(Mesh=flatten(mf_3), Angle=100, MergeVertices=True, FlipMesh=False, CombineType=1)

# ---- group: Mesh Status
ms = ElementMeshStatus(Mesh=mc_3, MergeVertices=False)  # -> Info, Status

# ----
preview = CustomPreview(Geometry=mc_3, Shader=ColourSwatch(SwatchColor=RGB(0, 141, 178)))
panel = Panel(ms.Status)
panel_2 = Panel(ms.Info)
