# Grasshopper definition 1.3.2.1_attractor definition.gh (Grasshopper 0.9.75)

# F.2.1.0
# Attractor Definition
cell_radius = Slider(0.5, range=0..1)
of_cells = Slider(10, range=0..10)

# ---- group: Attractor Point
# Click to enable the gumball
# and move the attractor point
pt = Point(Point(0.9174710837, 1.68950424, 2.684657556))

# ----
hexgrid = Hexagonal(Plane=PlaneXY(0, 0, 0), Size=cell_radius, ExtentX=of_cells, ExtentY=of_cells)  # -> Cells, Points
# Adjust circle size
offset_distance = Slider(-0.255, range=-0.5..0)
vec2pt = Vector2Pt(PointA=hexgrid.Points, PointB=pt, Unitize=False)  # -> Vector, Length
circle = CircleCNR(Center=hexgrid.Points, Normal=vec2pt.Vector, Radius=cell_radius)
offset = Offset(Curve=circle, Distance=offset_distance, Plane=PlaneXY(0, 0, 0), Corners=1)
boundary = BoundarySurfaces(Edges=offset)
