# Grasshopper definition 1.3.3.4_trigonometry components.gh (Grasshopper 0.9.75)

# Adjust number of points
# Helix Curve
number_slider = Slider(20, range=10..40)
# Spiral Curve
number_slider_2 = Slider(20, range=10..40)
X = UnitX(Factor=1)
X_2 = UnitX(Factor=1)
X_3 = UnitX(Factor=1)
# F.2.2.3
# Trigonometry Components
# Sine Curve
# Right-Click and
# select set one point
# to create or select a
# point in model space
pt = Point(Point(0, 0, 0))
pt_2 = Point(Point(0, 0, 0))
pt_3 = Point(Point(0, 0, 0))
arrlinear = LinearArray(Geometry=pt, Direction=X, Count=number_slider)  # -> Geometry, Transform
arrlinear_2 = LinearArray(Geometry=pt_2, Direction=X_2, Count=number_slider_2)  # -> Geometry, Transform
arrlinear_3 = LinearArray(Geometry=pt_3, Direction=X_3, Count=Slider(28, range=10..40))  # -> Geometry, Transform
pdecon = Deconstruct(Point=arrlinear.Geometry)  # -> XComponent, YComponent, ZComponent
pdecon_2 = Deconstruct(Point=arrlinear_2.Geometry)  # -> XComponent, YComponent, ZComponent
pdecon_3 = Deconstruct(Point=arrlinear_3.Geometry)  # -> XComponent, YComponent, ZComponent
sin = Sine(Value=pdecon.XComponent)
sin_2 = Sine(Value=pdecon_2.XComponent)
cos = Cosine(Value=pdecon_2.XComponent)
sin_3 = Sine(Value=pdecon_3.XComponent)
cos_2 = Cosine(Value=pdecon_3.XComponent)
pt_4 = ConstructPoint(XCoordinate=pdecon.XComponent, YCoordinate=sin, ZCoordinate=0)
pt_5 = ConstructPoint(XCoordinate=pdecon_2.XComponent, YCoordinate=sin_2, ZCoordinate=cos)
multiplication = Multiplication(A=pdecon_3.XComponent, B=sin_3)
multiplication_2 = Multiplication(A=pdecon_3.XComponent, B=cos_2)
intcrv = Interpolate(Vertices=pt_4, Degree=3, Periodic=False, KnotStyle=1)  # -> Curve, Length, Domain
intcrv_2 = Interpolate(Vertices=pt_5, Degree=3, Periodic=False, KnotStyle=1)  # -> Curve, Length, Domain
pt_6 = ConstructPoint(XCoordinate=multiplication, YCoordinate=0, ZCoordinate=multiplication_2)
intcrv_3 = Interpolate(Vertices=pt_6, Degree=3, Periodic=False, KnotStyle=1)  # -> Curve, Length, Domain
