# Grasshopper definition 1.3.3_operators and conditionals.gh (Grasshopper 0.9.75)

# ---- group: Similarity
tolerance = Panel("20")
similar = Similarity(FirstNumber="2", SecondNumber="2.5", Threshold=tolerance)  # -> Similarity, AbsoluteDifference
similarity = Panel(similar.Similarity)
difference = Panel(similar.AbsoluteDifference)

# ---- group: Addition
# F.2.2
# Operators and Conditionals
panel = Panel("3.6")
addition = Addition(A=panel, B="2")
result = Panel(addition)

# ---- group: Subtraction
subtraction = Subtraction(A="3.6", B="2")
result_2 = Panel(subtraction)

# ---- group: Multiplication
multiplication = Multiplication(A="3.6", B="2")
result_3 = Panel(multiplication)

# ---- group: Division
division = Division(A="3.6", B="2")
result_4 = Panel(division)

# ---- group: Modulus
mod = Modulus(A="3.6", B="2")
result_5 = Panel(mod)

# ---- group: Power
pow = Power(A="3.6", B="2")
result_6 = Panel(pow)

# ---- group: Equality
equals = Equality(FirstNumber="2", SecondNumber="4.5")  # -> Equality, Inequality
equality = Panel(equals.Equality)
inequality = Panel(equals.Inequality)

# ---- group: Larger than
larger = LargerThan(FirstNumber="2", SecondNumber="5")  # -> LargerThan, OrEqualTo
larger_than = Panel(larger.LargerThan)
or_equal_to = Panel(larger.OrEqualTo)

# ---- group: Smaller than
smaller = SmallerThan(FirstNumber="2", SecondNumber="2")  # -> SmallerThan, OrEqualTo
smaller_than = Panel(smaller.SmallerThan)
or_equal_to_2 = Panel(smaller.OrEqualTo)
