# Grasshopper definition 1.4.3_data matching.gh (Grasshopper 0.9.75)

# ---- group: Trim Start
panel = Panel("""A
B
C
D
E""")
panel_2 = Panel("""X
Y
Z""")
short = ShortestList(ListA=panel, ListB=panel_2, TrimMode=1)  # -> ListA, ListB
panel_3 = Panel(short.ListA)
panel_4 = Panel(short.ListB)

# ---- group: Interpolate
panel_5 = Panel("""X
Y
Z""")
panel_6 = Panel("""A
B
C
D
E""")
short_2 = ShortestList(ListA=panel_6, ListB=panel_5, TrimMode=3)  # -> ListA, ListB
panel_7 = Panel(short_2.ListA)
panel_8 = Panel(short_2.ListB)

# ---- group: Trim End
# F.3.2
# Data Stream Matching
# Shortest List
panel_9 = Panel("""A
B
C
D
E""")
panel_10 = Panel("""X
Y
Z""")
short_3 = ShortestList(ListA=panel_9, ListB=panel_10, TrimMode=2)  # -> ListA, ListB
panel_11 = Panel(short_3.ListA)
panel_12 = Panel(short_3.ListB)

# ---- group: Repeat Last
# Longest List
panel_13 = Panel("""A
B
C
D
E""")
panel_14 = Panel("""X
Y
Z""")
long = LongestList(ListA=panel_13, ListB=panel_14, PaddingMode=2)  # -> ListA, ListB
panel_15 = Panel(long.ListA)
panel_16 = Panel(long.ListB)

# ---- group: Repeat First
panel_17 = Panel("""A
B
C
D
E""")
panel_18 = Panel("""X
Y
Z""")
long_2 = LongestList(ListA=panel_17, ListB=panel_18, PaddingMode=1)  # -> ListA, ListB
panel_19 = Panel(long_2.ListA)
panel_20 = Panel(long_2.ListB)

# ---- group: Interpolate
panel_21 = Panel("""A
B
C
D
E""")
panel_22 = Panel("""X
Y
Z""")
long_3 = LongestList(ListA=panel_21, ListB=panel_22, PaddingMode=3)  # -> ListA, ListB
panel_23 = Panel(long_3.ListA)
panel_24 = Panel(long_3.ListB)

# ---- group: Wrap
panel_25 = Panel("""X
Y
Z""")
panel_26 = Panel("""A
B
C
D
E""")
long_4 = LongestList(ListA=panel_26, ListB=panel_25, PaddingMode=4)  # -> ListA, ListB
panel_27 = Panel(long_4.ListA)
panel_28 = Panel(long_4.ListB)

# ---- group: Flip
panel_29 = Panel("""X
Y
Z""")
panel_30 = Panel("""A
B
C
D
E""")
long_5 = LongestList(ListA=panel_30, ListB=panel_29, PaddingMode=5)  # -> ListA, ListB
panel_31 = Panel(long_5.ListA)
panel_32 = Panel(long_5.ListB)

# ---- group: Diagonal
panel_33 = Panel("""A
B
C""")
panel_34 = Panel("""X
Y
Z""")
crossref = CrossReference(ListA=panel_33, ListB=panel_34, CrossMode=2)  # -> ListA, ListB
panel_35 = Panel(crossref.ListA)
panel_36 = Panel(crossref.ListB)

# ---- group: Lower
panel_37 = Panel("""A
B
C""")
panel_38 = Panel("""X
Y
Z""")
crossref_2 = CrossReference(ListA=panel_37, ListB=panel_38, CrossMode=4)  # -> ListA, ListB
panel_39 = Panel(crossref_2.ListA)
panel_40 = Panel(crossref_2.ListB)

# ---- group: Lower Strict
panel_41 = Panel("""A
B
C""")
panel_42 = Panel("""X
Y
Z""")
crossref_3 = CrossReference(ListA=panel_41, ListB=panel_42, CrossMode=5)  # -> ListA, ListB
panel_43 = Panel(crossref_3.ListA)
panel_44 = Panel(crossref_3.ListB)

# ---- group: Holistic
# Cross Reference
panel_45 = Panel("""A
B
C""")
panel_46 = Panel("""X
Y
Z""")
crossref_4 = CrossReference(ListA=panel_45, ListB=panel_46, CrossMode=1)  # -> ListA, ListB
panel_47 = Panel(crossref_4.ListA)
panel_48 = Panel(crossref_4.ListB)
